% Simulink data dictionary VTOLDynamicsData.sldd

ControlSampleTime = 0.005
FWTrimSpeed = 166.667
UAVSampleTime = 0.005
Vcruise = 16
Vt = 14

control = struct(
  turningRadius=60,
  L1=60,
  transitionRadius=60,
  minThrottle=0,
  maxThrottle=1,
  slewRateThrottle=1,
  slewRateServos=5,
  maxPitch=0.1745329,
  minPitch=-0.1745329,
  maxRoll=0.6981317,
  minRoll=-0.6981317,
  maxRollRate=1.22173,
  minRollRate=-1.22173,
  maxPitchRate=1.22173,
  minPitchRate=-1.22173,
  maxClimbRate=3,
  maxDescendRate=-3,
  stallSpeed=9.5,
  cruiseSpeed=20,
  takeoffSpeed=12.35,
  takeoffNavAlt=5,
  climboutAltMin=10,
  climboutAlt=13,
  landingApproachSpeed=12.35,
  flarePitch=0.03490659,
  flareAlt=2,
  landStopVel=1,
  finalLoiterSpeed=15)

tilt_trim = 0
windVel = [0 0 0]

doubleUavPathManager = Simulink.Bus()
  mode: uint8
  position: double[3 1]
  params: double[4 1]

innerLoopCmdsBus = Simulink.Bus()
  LAP: double[3]
  HeadingCmd: double
  YawCmd: double

FWControl = struct(transitionRadius=10)

GuidanceStates = Simulink.Bus()
  Euler: double[3]
  pqr: double[3]
  Ve: double[3]
  Xe: double[3]
  course: double
  Tilt: double

MaxTilt = 1.047198
TiltScheduleRate = 0.2617994
CriticalTiltAngle = 1.047198
WindDownRate = 20

env = struct(
  ISA_lapse=0.0065,
  ISA_hmax=2000,
  ISA_R=287.0531,
  ISA_g=9.80665,
  ISA_rho0=1.225,
  ISA_P0=101325,
  ISA_T0=288.15,
  windBase=12,
  windDirTurb=180,
  windDirHor=90,
  windOn=0)

FixedWingCtrlBus = Simulink.Bus()
  dA: double
  dE: double
  dR: double
  dT: double

stateBus = Simulink.Bus()
  course: double
  gndspeed: double
  airspeed: double
  Xe: double[3 1]
  Ve: double[3 1]
  DCMbe: double[3 3]
  q: double[1 4]
  pqr: double[3 1]
  Vb: double[1 3]
  Abb: double[1 3]
  Abe: double[1 3]
  Euler: double[3 1]
  RotorParameters: Bus: RotorCtrlBus
  ypr: double[3 1]
  Ve_ground: double[3 1]

MAVLink_Input_Read_Size = 1024

RotorCtrlBus = Simulink.Bus()
  w1: double
  w2: double
  w3: double
  w4: double
  Tilt1: double
  Tilt2: double
  T1: double
  T2: double
  T3: double
  T4: double

VTOLConfiguration = Simulink.ConfigSet(StartTime="0", StopTime="simTime", RelTol="1e-3", Solver="VariableStepAuto", ProdHWDeviceType="Intel->x86-64 (Windows64)", SystemTargetFile="ert.tlc", TargetLang="C")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
DeploymentConfiguration = Simulink.ConfigSet(StartTime="0", StopTime="inf", Solver="FixedStepAuto", ProdHWDeviceType="ARM Compatible->ARM Cortex", SystemTargetFile="ert.tlc", HardwareBoard="PX4 Cube Orange+", TargetLang="C++")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
simTime = 400
w_trim = 110.3673

uavParam_Works = struct(
  aero=struct(
    rho=1.225,
    CL0=0.81857,
    CLa=4.09127,
    CLa_dot=0,
    CLq=7.31097,
    CLDe=0.50787,
    CLDa=-0.85291,
    CDmin=0.06047,
    K=0.1328,
    CL_CDmin=0.4806,
    A1=0,
    CdDe=0.016043,
    CdDa=0.092132,
    CdDr=0.0097403,
    Cm0=0.00763,
    Cma=-1.76966,
    Cmq=-19.22663,
    CmDe=-1.83747,
    CYb=-0.00157,
    CYp=-0.00157,
    CYr=0.18368,
    CYDr=0.128915,
    Clb=-0.00161,
    Clp=-0.47584,
    Clr=0.27153,
    ClDa=0.286593,
    ClDr=0.013407,
    Cnb=0.0918,
    Cnp=-0.13267,
    Cnr=-0.08829,
    CnDa=0.0049274,
    CnDr=-0.067036,
    dragCoeffMov=0.027,
    g=9.806),
  geom=struct(
    b=2,
    AR=7.2727,
    c=0.275,
    e=0.986,
    RotorArm1=[0.375 0.375 0],
    RotorArm2=[0.375 -0.375 0],
    RotorArm3=[-0.375 -0.375 0],
    RotorArm4=[-0.375 0.375 0],
    Ixx=0.267,
    Iyy=0.267,
    Izz=0.375,
    mass=6.023,
    PropDiameter=0.3052,
    RotorArm5=[0.55 0 0]),
  motor=struct(RPMMAX=10000, tilt_trim=0))